% Simulink data dictionary SGKitControllerData.sldd
% references focDemo_Data.sldd

paramEncoderCalibrationDuration = 0.2
paramEncoderCalibrationMaxError = 0.0007853982
paramEncoderRotorPositionAtZeroCount = 0.22933
paramOpenLoopVelocityAcceleration = 40
paramOpenLoopVelocityToVoltsBias = 0.5
paramPwmCompareAtZeroVolt = 750
paramPwmCompareMax = 1500
paramPwmComparePerVolt = 62.5
paramVelocityControlSatCurrent = Simulink.Parameter(4)
paramEnFluxWeakening = 0
paramKawFluxWeakening = 100
paramKiFluxWeakening = 150
paramOpenLoopVelocityToVoltsScalar = 0.05
PolePairs = 7
paramEncoderRotorPositionPerCount = 0.0003835
paramEncoderCalibrationVoltage = 2
paramCurrentControlI = 200
paramCurrentControlP = 0.5
paramEncoderCalibrateAtStartup = 1
paramOverCurrentEnable = 1
paramOverCurrentLimit = 20
paramOverCurrentDuration = 0.001
paramCurrentControlSatVoltage = 20
paramAdcAmperePerTransducerVolt = [-15.015015 -15.015015]
paramVelocityControlP = 0.05
paramVelocityControlI = 0.1
paramVelocityFilterCoeffNum = 0.003328
paramVelocityFilterCoeffDen = [1 -0.9967]
paramAdcTransducerVoltAtZeroAmpere = [0.0015 0.023]